vi "index.gviweb"   [LabVIEW NXG 4.0.0]
panel indicators:
  "LED": bool
  "Chart": i32
diagram:
  s1 = FALSE  # shift register
  while (iteration -> i1) {
    Quotient And Remainder(x=i1, y=20) -> (x-y*floor(x/y)=w1)
    Is Equal To 0(x=w1) -> w2
    Not(x=s1) -> w3
    Select(s=w2, t=w3, f=s1) -> w4
    $LED <- w4
    $Chart <- w1
    Wait(time to wait=50)
    next s1 = w4
    stop if FALSE
  }
